# Dynamo graph section2.dyn "section3" (Dynamo 3.3.0.6316)

byPoints = PolyCurve.ByPoints()  # unwired: points
file_path = Filename("개인 제출용 서류\공부\새 폴더\Py_Revit_Dynamo\test.py")
readText = FileSystem.ReadText(file=file_path)
file_path_2 = Filename("개인 제출용 서류\공부\새 폴더\Py_Revit_Dynamo\pointRead.py")
readText_2 = FileSystem.ReadText(file=file_path_2)
csv_파일 = Filename("C:\Users\user\Desktop\개인 제출용 서류\공부\새 폴더\Py_Revit_Dynamo\data\Civil Report.csv")
code_block = CodeBlock { -1; 200; }
python_script_from_string = PythonStringNode(script=readText, IN[0]=readText_2, IN[1]=csv_파일, IN[2]=code_block.out0, IN[3]=code_block.out1)  # CPython3
watch = Watch(python_script_from_string)
byPoints_2 = PolyCurve.ByPoints(points=watch)
type = Object.Type(object=watch)
